# Grasshopper definition Mathematical Surface_Week1_HOPS.gh (Grasshopper 1.0.8)
# plug-ins: RhinoCodePluginGH, Kangaroo Components, Bifocals, Weaverbird

get_number = GetNumber(Slider(1, range=1..6), AtLeast=1, AtMost=1, Maximum=1.797693135e+308, Minimum=-1.797693135e+308, TreeAccess=False)
get_number_2 = GetNumber(Slider(-8, range=-8..8), AtLeast=1, AtMost=1, Maximum=1.797693135e+308, Minimum=-1.797693135e+308, TreeAccess=False)
get_number_3 = GetNumber(Slider(100, range=1..100), AtLeast=1, AtMost=1, Maximum=1.797693135e+308, Minimum=-1.797693135e+308, TreeAccess=False)
get_number_4 = GetNumber(Slider(1, range=1..180), AtLeast=1, AtMost=1, Maximum=1.797693135e+308, Minimum=-1.797693135e+308, TreeAccess=False)
get_number_5 = GetNumber(Slider(1, range=1..10), AtLeast=1, AtMost=1, Maximum=1.797693135e+308, Minimum=-1.797693135e+308, TreeAccess=False)
get_number_6 = GetNumber(Slider(1, range=1..5), AtLeast=1, AtMost=1, Maximum=1.797693135e+308, Minimum=-1.797693135e+308, TreeAccess=False)

py3 = Python3Script(
    amplitude=get_number,
    frequency=get_number_2,
    resolution=get_number_3,
    radius_max=get_number_4,
    layers=get_number_5,
    twist_factor=get_number_6)  # -> surface, a
# ---------- py3: Python ----------
import rhinoscriptsyntax as rs
import math
import Rhino.Geometry as rg

# Parameters for mandala effect
amplitude = 6         # Height variation
frequency = -8         # Number of waves around the circle
resolution = 100      # Number of points along radial and angular directions
radius_max = 35       # Maximum radius of the mandala
layers = 5           # Number of concentric layers (like circles)
twist_factor = 3     # Twisting or rotation factor for the mandala pattern

# Create a list to hold points
points = []

# Create polar coordinates and generate points in radial symmetry
for i in range(layers):
    r = (i / float(layers)) * radius_max  # Radial step
    for j in range(resolution):
        t = (j / float(resolution)) * 2 * math.pi  # Angular step

        # Apply sine and cosine to create circular waves and symmetry
        x = r * math.sin(t)
        y = r * math.cos(t)
        z = amplitude * math.sin(frequency * t + twist_factor * r)

        # Create 3D point
        point = rg.Point3d(x, y, z)
        points.append(point)

# Convert points into a surface
surface = rg.NurbsSurface.CreateFromPoints(points, layers, resolution, 3, 3)

# Output surface
a = surface
# ---------- end py3 ----------

brep = Brep(py3.a)
mesh = MeshBrep(
    Brep=brep,
    Settings={GridMaxCount=0, GridMinCount=16, JaggedSeams=False, MaxEdgeLength=0, MinEdgeLength=0.0001, MinTolerance=0, Refine=True, RefineAngle=0, RelativeTolerance=0.65, SimplePlanes=True, Tolerance=0})

# ---- group: Refine and Rebuilt
mirror = Mirror(Geometry=mesh, Plane=PlaneYZ(0, 0, 0))  # -> Geometry, Transform
Z = UnitZ(Factor=Slider(-1, range=-8..0))
move = Move(Geometry=mirror.Geometry, Motion=Z)  # -> Geometry, Transform

# ----
qrmesh = QuadRemesh(Geometry=move.Geometry, Settings={aqc=True, as=50, dhe=True, gci=0, null=False, pme=2, sa=0, tqc=2000})

number_slider = Slider(5, range=0..10)
wbframe = WeaverbirdsPictureFrame(MeshPolylines=qrmesh, Distance=number_slider, InsetType=0)
wbwindow = WeaverbirdsMeshWindow(MeshPolylines=qrmesh, Distance=number_slider, InsetType=0)

wbthicken = WeaverbirdsMeshThicken(MeshCurves=mesh, Distance=Slider(0.5, range=0.1..1), OffsetType=0)

clean = CombineClean(Meshes=wbthicken)
clean_2 = CombineClean(Meshes=wbwindow)
clean_3 = CombineClean(Meshes=wbframe)
mesh_2 = Mesh(clean)
mesh_3 = Mesh(clean_3)
mesh_4 = Mesh(clean_2)
context_bake = ContextBake(Content=mesh_2)
context_bake_2 = ContextBake(Content=mesh_3)
context_bake_3 = ContextBake(Content=mesh_4)
