# Grasshopper definition Rhino7_MathematicalSurfaceWeek1HOPS.gh (Grasshopper 1.0.7)

amplitude = GetNumber(
    Slider(4.84, range=1..6),
    AtLeast=1,
    AtMost=1,
    Maximum=1.797693135e+308,
    Minimum=-1.797693135e+308,
    Prompt="Value limits from 1.00 to 6.00 (float)",
    TreeAccess=False)
frequency = GetNumber(
    Slider(-10, range=-10..0),
    AtLeast=1,
    AtMost=1,
    Maximum=1.797693135e+308,
    Minimum=-1.797693135e+308,
    Prompt="Negative Value limits from (-10.00 to 0) (float)",
    TreeAccess=False)
radius_max = GetNumber(
    Slider(11, range=1..20),
    AtLeast=1,
    AtMost=1,
    Maximum=1.797693135e+308,
    Minimum=-1.797693135e+308,
    Prompt="Value limits from 1.00 to 20.00 (float)",
    TreeAccess=False)
layers = GetNumber(
    Slider(4, range=1..10),
    AtLeast=1,
    AtMost=1,
    Maximum=1.797693135e+308,
    Minimum=-1.797693135e+308,
    Prompt="Value limits from 1.00 to 10.00 (float)",
    TreeAccess=False)
twist_factor = GetNumber(
    Slider(4.56, range=1..5),
    AtLeast=1,
    AtMost=1,
    Maximum=1.797693135e+308,
    Minimum=-1.797693135e+308,
    Prompt="Value limits from 1.00 to 5.00 (float)",
    TreeAccess=False)
python = GhPythonScript(amplitude=amplitude, frequency=frequency, radius_max=radius_max, layers=layers, twist_factor=twist_factor)  # -> a
# ---------- python: Python ----------
import rhinoscriptsyntax as rs
import math
import Rhino.Geometry as rg

# Example parameter values (in practice, these might be GH inputs)
amplitude = amplitude           
frequency = frequency          
resolution = 100         
radius_max = radius_max        
layers = layers             
twist_factor = twist_factor      

# Ensure integer counts (in case they come as floats)
layers_int = int(layers)
resolution_int = int(resolution)

points_2d = []

# Generate points in 2D list
for i in range(layers_int):
    row_points = []
    # radial parameter for layer i
    if layers_int > 1:
        r = (i / float(layers_int - 1)) * radius_max
    else:
        r = 0
    
    for j in range(resolution_int):
        # angular parameter for column j
        if resolution_int > 1:
            t = (j / float(resolution_int - 1)) * 2.0 * math.pi
        else:
            t = 0
        
        x = r * math.sin(t)
        y = r * math.cos(t)
        z = amplitude * math.sin(frequency * t + twist_factor * r)
        row_points.append(rg.Point3d(x, y, z))
    
    points_2d.append(row_points)

# --- FIX 1: Flatten the 2D list into a 1D list -------------------------
flat_points = [pt for row in points_2d for pt in row]

# Create the NURBS surface from the flattened points
surface = rg.NurbsSurface.CreateFromPoints(
    flat_points,       # 1D list
    layers_int,        # rows
    resolution_int,    # columns
    3,                 # uDegree
    3                  # vDegree
)

# Output or return your surface
a = surface
# ---------- end python ----------
brep = Brep(python)
context_bake = ContextBake(Geometry=brep)
